# Grasshopper definition Space Stack Iteration.gh (Grasshopper 1.0.7)
# plug-ins: Kangaroo2 Components

point = Point(Point(0, 0, 0))
point_2 = Point(Point(0, 0, 0))
circle_cnr = CircleCNR(Center=point, Normal=Vector(0, 0, 1), Radius=Slider(45, range=0..100))
circle_cnr_2 = CircleCNR(Center=point_2, Normal=Vector(0, 0, 1), Radius=Slider(20, range=0..100))
unit_x = UnitX(Factor=Slider(120, range=0..1000))
scale_nu = ScaleNU(Geometry=circle_cnr_2, Plane=PlaneXY(0, 0, 0), ScaleX=1, ScaleY=Slider(1.5, range=0..10), ScaleZ=1)  # -> Geometry, Transform
scale_nu_2 = ScaleNU(Geometry=circle_cnr, Plane=PlaneXY(0, 0, 0), ScaleX=1, ScaleY=Slider(1.54, range=0..10), ScaleZ=1)  # -> Geometry, Transform
linear_array = LinearArray(Geometry=scale_nu.Geometry, Direction=unit_x, Count=10)  # -> Geometry, Transform
linear_array_2 = LinearArray(Geometry=scale_nu_2.Geometry, Direction=unit_x, Count=10)  # -> Geometry, Transform

populate_geometry = PopulateGeometry(Geometry=linear_array_2.Geometry, Count=Slider(3, range=0..10), Seed=Slider(85, range=0..100))
list_item = ListItem(List=populate_geometry, Index=0, Wrap=True)  # -> Item, Item1, Item2
point_3 = Point(list_item.Item)
point_4 = Point(list_item.Item1)
point_5 = Point(list_item.Item2)

# ---- group: XY PLANE EXTRUSION
offset_curve = OffsetCurve(Curve=linear_array_2.Geometry, Distance=Slider(10, range=0..10), Corners=1)
unit_z = UnitZ(Factor=Slider(6, range=0..10))
boundary_surfaces = BoundarySurfaces(Edges=offset_curve)
negative = Negative(Value=unit_z)
extrude = Extrude(Base=boundary_surfaces, Direction=negative)

# ---- group: RANDOM NODE GENERATION
boundary_surfaces_2 = BoundarySurfaces(Edges=linear_array.Geometry)
construct_domain = ConstructDomain(DomainStart=Slider(1, range=0..1), DomainEnd=Slider(100, range=0..100))
random = Random(Range=construct_domain, Number=Slider(10, range=0..10), Seed=2)
populate_geometry_2 = PopulateGeometry(Geometry=boundary_surfaces_2, Count=Slider(1, range=0..1), Seed=random)  # -> graft(Population)

# ----
line = Line(StartPoint=populate_geometry, EndPoint=populate_geometry_2)
multipipe = MultiPipe(
    Curves=line,
    NodeSize=Slider(0.9, range=0..10),
    EndOffset=Slider(12, range=0..100),
    StrutSize=Slider(1.1, range=0..10),
    Segment=0,
    KinkAngle=0.6,
    CubeFit=0,
    Caps=0)
cap_holes = CapHoles(Brep=multipipe)
solid_difference = SolidDifference(BrepsA=flatten(cap_holes), BrepsB=flatten(extrude))
solid_difference_2 = SolidDifference(BrepsA=solid_difference, BrepsB=extrude)

# ---- group: LARGE NOD / LARGE NODES
sphere = Sphere(Base=point_5, Radius=Slider(7, range=0..10))
scale_nu_3 = ScaleNU(Geometry=sphere, Plane=PlaneXY(0, 0, 0), ScaleX=1, ScaleY=1, ScaleZ=Slider(0.6, range=0..1))  # -> Geometry, Transform
unit_z_2 = UnitZ(Factor=Slider(3.4, range=0..10))
move = Move(Geometry=scale_nu_3.Geometry, Motion=unit_z_2)  # -> Geometry, Transform

# ---- group: MEDOUM NODE / MEDIUM NODES
sphere_2 = Sphere(Base=point_4, Radius=Slider(6, range=0..10))
scale_nu_4 = ScaleNU(Geometry=sphere_2, Plane=PlaneXY(0, 0, 0), ScaleX=1, ScaleY=1, ScaleZ=Slider(0.6, range=0..1))  # -> Geometry, Transform
unit_z_3 = UnitZ(Factor=Slider(3.4, range=0..10))
move_2 = Move(Geometry=scale_nu_4.Geometry, Motion=unit_z_3)  # -> Geometry, Transform

# ----
cylinder = Cylinder(Base=[point_3, point_3], Radius=Slider(1.5, range=0..10), Length=Slider(5, range=0..10))
cylinder_2 = Cylinder(Base=[point_4, point_4], Radius=Slider(1.5, range=0..10), Length=Slider(5, range=0..10))
cylinder_3 = Cylinder(Base=[point_5, point_5], Radius=Slider(1.5, range=0..10), Length=Slider(5, range=0..10))
unit_z_4 = UnitZ(Factor=Slider(-1, range=-2..1))
move_3 = Move(Geometry=[cylinder, cylinder_2, cylinder_3], Motion=unit_z_4)  # -> Geometry, Transform
cap_holes_2 = CapHoles(Brep=move_3.Geometry)
solid_difference_3 = SolidDifference(BrepsA=solid_difference_2, BrepsB=flatten(cap_holes_2))

# ---- group: MEDOUM NODE / TOP MAGNET
cylinder_4 = Cylinder(Base=[point_4, point_4], Radius=Slider(1.5, range=0..10), Length=Slider(1.9, range=0..10))
unit_z_5 = UnitZ(Factor=Slider(5.7, range=0..10))
cap_holes_3 = CapHoles(Brep=cylinder_4)
move_4 = Move(Geometry=cap_holes_3, Motion=unit_z_5)  # -> Geometry, Transform

# ---- group: LARGE NOD / TOP MAGNET
cylinder_5 = Cylinder(Base=[point_5, point_5], Radius=Slider(1.5, range=0..10), Length=Slider(1.5, range=0..10))
unit_z_6 = UnitZ(Factor=Slider(6.35, range=0..10))
cap_holes_4 = CapHoles(Brep=cylinder_5)
move_5 = Move(Geometry=cap_holes_4, Motion=unit_z_6)  # -> Geometry, Transform

# ---- group: MEDOUM NODE / BOTTOM MAGNET
cylinder_6 = Cylinder(Base=[point_4, point_4], Radius=Slider(1.5, range=0..10), Length=Slider(1.6, range=0..10))
unit_z_7 = UnitZ(Factor=Slider(-0.45, range=-2.222..10))
move_6 = Move(Geometry=cylinder_6, Motion=unit_z_7)  # -> Geometry, Transform

# ---- group: LARGE NOD / BOTTOM MAGNET
cylinder_7 = Cylinder(Base=[point_5, point_5], Radius=Slider(1.5, range=0..10), Length=Slider(2.2, range=0..10))
unit_z_8 = UnitZ(Factor=Slider(-1.1, range=-2.222..10))
move_7 = Move(Geometry=cylinder_7, Motion=unit_z_8)  # -> Geometry, Transform

# ---- group: SMALL NODE / TOP MAGNET
cylinder_8 = Cylinder(Base=[point_3, point_3], Radius=Slider(1.5, range=0..10), Length=Slider(1.5, range=0..10))
unit_z_9 = UnitZ(Factor=Slider(4, range=0..10))
cap_holes_5 = CapHoles(Brep=cylinder_8)
move_8 = Move(Geometry=cap_holes_5, Motion=unit_z_9)  # -> Geometry, Transform

# ---- group: SMALL NODE / BOTTOM MAGNET
cylinder_9 = Cylinder(Base=[point_3, point_3], Radius=Slider(1.5, range=0..10), Length=Slider(1.5, range=0..10))
unit_z_10 = UnitZ(Factor=Slider(-0.5, range=-2.222..10))
move_9 = Move(Geometry=cylinder_9, Motion=unit_z_10)  # -> Geometry, Transform

# ---- group: LARGE NOD
solid_difference_4 = SolidDifference(BrepsA=move.Geometry, BrepsB=move_5.Geometry)
solid_difference_5 = SolidDifference(BrepsA=solid_difference_4, BrepsB=move_7.Geometry)

# ---- group: MEDOUM NODE
solid_difference_6 = SolidDifference(BrepsA=move_2.Geometry, BrepsB=move_4.Geometry)
solid_difference_7 = SolidDifference(BrepsA=solid_difference_6, BrepsB=move_6.Geometry)

# ----
brep = Brep(extrude)

# ---- group: SMALL NODE / SMALL NODES
sphere_3 = Sphere(Base=point_3, Radius=Slider(6, range=0..10))
scale_nu_5 = ScaleNU(Geometry=sphere_3, Plane=PlaneXY(0, 0, 0), ScaleX=1, ScaleY=1, ScaleZ=Slider(0.45, range=0..1))  # -> Geometry, Transform

# ---- group: SMALL NODE
unit_z_11 = UnitZ(Factor=Slider(2.5, range=0..10))

# ---- group: SMALL NODE / SMALL NODES (continued)
move_10 = Move(Geometry=scale_nu_5.Geometry, Motion=unit_z_11)  # -> Geometry, Transform

# ---- group: SMALL NODE (continued)
solid_difference_8 = SolidDifference(BrepsA=move_10.Geometry, BrepsB=move_8.Geometry)
solid_difference_9 = SolidDifference(BrepsA=solid_difference_8, BrepsB=move_9.Geometry)

# ---- group: NODES - XY PLANE
brep_2 = Brep(brep)
solid_difference_10 = SolidDifference(BrepsA=solid_difference_9, BrepsB=brep_2)
solid_difference_11 = SolidDifference(BrepsA=solid_difference_7, BrepsB=brep_2)
solid_difference_12 = SolidDifference(BrepsA=solid_difference_5, BrepsB=brep_2)

# ---- group: BAKE
panel = Panel("BAKE")
group = Group(Objects=[solid_difference_10, solid_difference_11, solid_difference_12, solid_difference_3])
