# Grasshopper definition Xylo_Mass Production.gh (Grasshopper 1.0.7)
# plug-ins: Kangaroo2 Components

# ---- group: MEDIUM NODES
sphere = Sphere(Base=PlaneXY(0, 0, 0), Radius=Slider(6, range=0..10))
scale_nu = ScaleNU(Geometry=sphere, Plane=PlaneXY(0, 0, 0), ScaleX=1, ScaleY=1, ScaleZ=Slider(0.6, range=0..1))  # -> Geometry, Transform
unit_z = UnitZ(Factor=Slider(3.4, range=0..10))
move = Move(Geometry=scale_nu.Geometry, Motion=unit_z)  # -> Geometry, Transform

# ---- group: LARGE NODES
sphere_2 = Sphere(Base=PlaneXY(0, 0, 0), Radius=Slider(7, range=0..10))
scale_nu_2 = ScaleNU(Geometry=sphere_2, Plane=PlaneXY(0, 0, 0), ScaleX=1, ScaleY=1, ScaleZ=Slider(0.6, range=0..1))  # -> Geometry, Transform
unit_z_2 = UnitZ(Factor=Slider(3.4, range=0..10))
move_2 = Move(Geometry=scale_nu_2.Geometry, Motion=unit_z_2)  # -> Geometry, Transform

# ----
unit_z_3 = UnitZ(Factor=Slider(2.5, range=0..10))

# ---- group: SMALL NODES
sphere_3 = Sphere(Base=PlaneXY(0, 0, 0), Radius=Slider(6, range=0..10))
scale_nu_3 = ScaleNU(Geometry=sphere_3, Plane=PlaneXY(0, 0, 0), ScaleX=1, ScaleY=1, ScaleZ=Slider(0.45, range=0..1))  # -> Geometry, Transform
move_3 = Move(Geometry=scale_nu_3.Geometry, Motion=unit_z_3)  # -> Geometry, Transform

# ---- group: TOP MAGNET
cylinder = Cylinder(Base=PlaneXY(0, 0, 0), Radius=Slider(1.5, range=0..10), Length=Slider(1.5, range=0..10))
unit_z_4 = UnitZ(Factor=Slider(5.7, range=0..10))
cap_holes = CapHoles(Brep=cylinder)
move_4 = Move(Geometry=cap_holes, Motion=unit_z_4)  # -> Geometry, Transform

cylinder_2 = Cylinder(Base=PlaneXY(0, 0, 0), Radius=Slider(1.5, range=0..10), Length=Slider(1.5, range=0..10))
unit_z_5 = UnitZ(Factor=Slider(4, range=0..10))
cap_holes_2 = CapHoles(Brep=cylinder_2)
move_5 = Move(Geometry=cap_holes_2, Motion=unit_z_5)  # -> Geometry, Transform

# ---- group: BOTTOM MAGNET
cylinder_3 = Cylinder(Base=PlaneXY(0, 0, 0), Radius=Slider(1.5, range=0..10), Length=Slider(1.5, range=0..10))
unit_z_6 = UnitZ(Factor=Slider(-0.45, range=-2.222..10))
move_6 = Move(Geometry=cylinder_3, Motion=unit_z_6)  # -> Geometry, Transform

cylinder_4 = Cylinder(Base=PlaneXY(0, 0, 0), Radius=Slider(1.5, range=0..10), Length=Slider(1.5, range=0..10))
unit_z_7 = UnitZ(Factor=Slider(-0.5, range=-2.222..10))
move_7 = Move(Geometry=cylinder_4, Motion=unit_z_7)  # -> Geometry, Transform

# ---- group: TOP MAGNET
cylinder_5 = Cylinder(Base=PlaneXY(0, 0, 0), Radius=Slider(1.5, range=0..10), Length=Slider(1.5, range=0..10))
unit_z_8 = UnitZ(Factor=Slider(6.35, range=0..10))
cap_holes_3 = CapHoles(Brep=cylinder_5)
move_8 = Move(Geometry=cap_holes_3, Motion=unit_z_8)  # -> Geometry, Transform

# ---- group: BOTTOM MAGNET
cylinder_6 = Cylinder(Base=PlaneXY(0, 0, 0), Radius=Slider(1.5, range=0..10), Length=Slider(1.5, range=0..10))
unit_z_9 = UnitZ(Factor=Slider(-1.1, range=-2.222..10))
move_9 = Move(Geometry=cylinder_6, Motion=unit_z_9)  # -> Geometry, Transform

# ----
solid_difference = SolidDifference(BrepsA=move.Geometry, BrepsB=move_4.Geometry)
solid_difference_2 = SolidDifference(BrepsA=move_3.Geometry, BrepsB=move_5.Geometry)
solid_difference_3 = SolidDifference(BrepsA=move_2.Geometry, BrepsB=move_8.Geometry)
solid_difference_4 = SolidDifference(BrepsA=solid_difference, BrepsB=move_6.Geometry)
solid_difference_5 = SolidDifference(BrepsA=solid_difference_2, BrepsB=move_7.Geometry)
solid_difference_6 = SolidDifference(BrepsA=solid_difference_3, BrepsB=move_9.Geometry)
multipipe = MultiPipe(
    NodeSize=Slider(1.5, range=0..10),
    EndOffset=Slider(6, range=0..100),
    StrutSize=Slider(0.75, range=0..10),
    Segment=0,
    KinkAngle=0.6,
    CubeFit=0,
    Caps=Slider(2, range=0..10))

# ---- group: SMALL CIRCLE
construct_domain = ConstructDomain(DomainStart=Slider(1, range=0..1), DomainEnd=Slider(0.49, range=0..10))

# ---- group: LARGE CIRCLE
number_slider = Slider(4, range=0..10)
unit_x = UnitX(Factor=Slider(200, range=0..1000))
circle_cnr = CircleCNR(Center="0,0,0", Normal=Vector(0, 0, 1), Radius=Slider(45, range=0..1000))
construct_domain_2 = ConstructDomain(DomainStart=Slider(1, range=0..1), DomainEnd=Slider(1.2, range=0..10))

# ---- group: ARRAY
linear_array = LinearArray(Geometry=circle_cnr, Direction=unit_x, Count=number_slider)  # -> Geometry, Transform
unit_y = UnitY(Factor=Slider(250, range=0..1000))
number_slider_2 = Slider(4, range=0..10)
linear_array_2 = LinearArray(Geometry=linear_array.Geometry, Direction=unit_y, Count=number_slider_2)  # -> flatten(Geometry), Transform

# ----
area = Area(Geometry=linear_array_2.Geometry)  # -> Area, Centroid

# ---- group: SMALL CIRCLE (continued)
multiplication = Multiplication(A=number_slider, B=number_slider_2)
random = Random(Range=construct_domain, Number=multiplication, Seed=2)
circle_cnr_2 = CircleCNR(Center=area.Centroid, Normal=Vector(0, 0, 1), Radius=Slider(30, range=0..1000))
scale = Scale(Geometry=circle_cnr_2, Center=area.Centroid, Factor=random)  # -> Geometry, Transform
scale_nu_4 = ScaleNU(Geometry=scale.Geometry, Plane=area.Centroid, ScaleX=Slider(1.2, range=0..10), ScaleY=1, ScaleZ=1)  # -> Geometry, Transform

# ---- group: LARGE CIRCLE (continued)
multiplication_2 = Multiplication(A=number_slider, B=number_slider_2)
random_2 = Random(Range=construct_domain_2, Number=multiplication_2, Seed=2)
scale_2 = Scale(Geometry=linear_array_2.Geometry, Center=area.Centroid, Factor=random_2)  # -> Geometry, Transform
scale_nu_5 = ScaleNU(Geometry=scale_2.Geometry, Plane=area.Centroid, ScaleX=1, ScaleY=Slider(1.5, range=0..10), ScaleZ=1)  # -> Geometry, Transform

# ---- group: RANDOM POINTS [LARGE CNR]
construct_domain_3 = ConstructDomain(DomainStart=Slider(1, range=0..1), DomainEnd=Slider(100, range=0..100))
random_3 = Random(Range=construct_domain_3, Number=multiplication_2, Seed=2)
populate_geometry = PopulateGeometry(Geometry=scale_nu_5.Geometry, Count=Slider(3, range=0..10), Seed=random_3)

# ---- group: RANDOM POINTS [SMALL CNR]
construct_domain_4 = ConstructDomain(DomainStart=Slider(1, range=0..1), DomainEnd=Slider(100, range=0..100))
surface = Surface(scale_nu_4.Geometry)
random_4 = Random(Range=construct_domain_4, Number=multiplication_2, Seed=2)
populate_geometry_2 = PopulateGeometry(Geometry=surface, Count=Slider(1, range=0..1), Seed=random_4)

# ---- group: BRANCH PRODUCTION
list_item = ListItem(List=populate_geometry, Index=0, Wrap=True)  # -> Item, Item1, Item2
line = Line(StartPoint=list_item.Item, EndPoint=populate_geometry_2)
line_2 = Line(StartPoint=list_item.Item1, EndPoint=populate_geometry_2)
line_3 = Line(StartPoint=list_item.Item2, EndPoint=populate_geometry_2)
cluster = Cluster(
    relay=multiplication_2,
    number=multiplication_2,
    seed=Slider(52, range=0..100),
    curve_2=line,
    geometry=line,
    curve=line,
    curve_3=line)  # -> population, y_axis, result
cluster_2 = Cluster(
    relay=multiplication_2,
    number=multiplication_2,
    seed=Slider(47, range=0..100),
    curve_2=line_2,
    geometry=line_2,
    curve=line_2,
    curve_3=line_2)  # -> population, y_axis, result
cluster_3 = Cluster(
    relay=multiplication_2,
    number=multiplication_2,
    seed=Slider(59, range=0..100),
    curve_2=line_3,
    geometry=line_3,
    curve=line_3,
    curve_3=line_3)  # -> population, y_axis, result
line_sdl = LineSDL(Start=cluster.population, Direction=cluster.y_axis, Length=cluster.result)
line_sdl_2 = LineSDL(Start=cluster_2.population, Direction=cluster_2.y_axis, Length=cluster_2.result)
line_sdl_3 = LineSDL(Start=cluster_3.population, Direction=cluster_3.y_axis, Length=cluster_3.result)
end_points = EndPoints(Curve=line_sdl)  # -> Start, End
end_points_2 = EndPoints(Curve=line)  # -> Start, End
end_points_3 = EndPoints(Curve=line_3)  # -> Start, End
end_points_4 = EndPoints(Curve=line_sdl_3)  # -> Start, End
end_points_5 = EndPoints(Curve=line_2)  # -> Start, End
end_points_6 = EndPoints(Curve=line_sdl_2)  # -> Start, End
curve_closest_point = CurveClosestPoint(Point=[end_points_6.Start, end_points_5.Start], Curve=line_2)  # -> Point, Parameter, Distance
curve_closest_point_2 = CurveClosestPoint(Point=[end_points_4.Start, end_points_3.Start], Curve=line_3)  # -> Point, Parameter, Distance
curve_closest_point_3 = CurveClosestPoint(Point=[end_points.Start, end_points_2.Start], Curve=line)  # -> Point, Parameter, Distance
shatter = Shatter(Curve=line, Parameters=curve_closest_point_3.Parameter)
shatter_2 = Shatter(Curve=line_2, Parameters=curve_closest_point.Parameter)
shatter_3 = Shatter(Curve=line_3, Parameters=curve_closest_point_2.Parameter)

# ---- group: BRANCHES / SECONDARY BRANCH
point = Point(end_points_4.End)
point_2 = Point(end_points.End)
point_3 = Point(end_points_6.End)

# ---- group: BRANCHES / PRIMARY BRANCH
point_4 = Point(end_points_2.Start)
point_5 = Point(end_points_5.Start)
point_6 = Point(end_points_3.Start)

# ---- group: LARGE NOD / LARGE NODES
sphere_4 = Sphere(Base=[point_5, point_6], Radius=Slider(7, range=0..10))
scale_nu_6 = ScaleNU(Geometry=sphere_4, Plane=PlaneXY(0, 0, 0), ScaleX=1, ScaleY=1, ScaleZ=Slider(0.6, range=0..1))  # -> Geometry, Transform
unit_z_10 = UnitZ(Factor=Slider(3.4, range=0..10))
move_10 = Move(Geometry=scale_nu_6.Geometry, Motion=unit_z_10)  # -> Geometry, Transform

# ---- group: MEDOUM NODE / MEDIUM NODES
sphere_5 = Sphere(Base=[point_2, point_3], Radius=Slider(6, range=0..10))
scale_nu_7 = ScaleNU(Geometry=sphere_5, Plane=PlaneXY(0, 0, 0), ScaleX=1, ScaleY=1, ScaleZ=Slider(0.6, range=0..1))  # -> Geometry, Transform
unit_z_11 = UnitZ(Factor=Slider(3.4, range=0..10))
move_11 = Move(Geometry=scale_nu_7.Geometry, Motion=unit_z_11)  # -> Geometry, Transform

# ---- group: MULTIPIPE SPINE
multipipe_2 = MultiPipe(
    Curves=flatten([shatter, shatter_2, shatter_3, line_sdl, line_sdl_2, line_sdl_3]),
    NodeSize=Slider(1.5, range=0..10),
    EndOffset=Slider(6, range=0..10),
    StrutSize=Slider(0.75, range=0..1),
    Segment=0,
    KinkAngle=0.6,
    CubeFit=0,
    Caps=Slider(2, range=0..10))
offset_curve = OffsetCurve(Curve=scale_nu_5.Geometry, Distance=Slider(25, range=0..100), Corners=1)
unit_z_12 = UnitZ(Factor=Slider(10, range=0..10))
cap_holes_4 = CapHoles(Brep=multipipe_2)
boundary_surfaces = BoundarySurfaces(Edges=offset_curve)
negative = Negative(Value=unit_z_12)
extrude = Extrude(Base=boundary_surfaces, Direction=negative)
solid_difference_7 = SolidDifference(BrepsA=cap_holes_4, BrepsB=extrude)
brep = Brep(extrude)

# ---- group: BOOLEAN DIFFERENCE SPINE
cylinder_7 = Cylinder(Base=[point_4, point_5, point_6], Radius=Slider(1.5, range=0..10), Length=Slider(5, range=0..10))
cylinder_8 = Cylinder(Base=[point_2, point_3, point], Radius=Slider(1.5, range=0..10), Length=Slider(5, range=0..10))
unit_z_13 = UnitZ(Factor=Slider(-1, range=-2..1))
move_12 = Move(Geometry=[cylinder_7, cylinder_8], Motion=unit_z_13)  # -> Geometry, Transform
cap_holes_5 = CapHoles(Brep=move_12.Geometry)
solid_difference_8 = SolidDifference(BrepsA=solid_difference_7, BrepsB=flatten(cap_holes_5))

# ---- group: MEDOUM NODE / TOP MAGNET
cylinder_9 = Cylinder(Base=[point_2, point_3], Radius=Slider(1.5, range=0..10), Length=Slider(1.9, range=0..10))
unit_z_14 = UnitZ(Factor=Slider(5.7, range=0..10))
cap_holes_6 = CapHoles(Brep=cylinder_9)
move_13 = Move(Geometry=cap_holes_6, Motion=unit_z_14)  # -> Geometry, Transform

# ---- group: LARGE NOD / TOP MAGNET
cylinder_10 = Cylinder(Base=[point_5, point_6], Radius=Slider(1.5, range=0..10), Length=Slider(1.5, range=0..10))
unit_z_15 = UnitZ(Factor=Slider(6.35, range=0..10))
cap_holes_7 = CapHoles(Brep=cylinder_10)
move_14 = Move(Geometry=cap_holes_7, Motion=unit_z_15)  # -> Geometry, Transform

# ---- group: SMALL NODE / TOP MAGNET
cylinder_11 = Cylinder(Base=[point_4, point], Radius=Slider(1.5, range=0..10), Length=Slider(1.5, range=0..10))
unit_z_16 = UnitZ(Factor=Slider(4, range=0..10))
cap_holes_8 = CapHoles(Brep=cylinder_11)
move_15 = Move(Geometry=cap_holes_8, Motion=unit_z_16)  # -> Geometry, Transform

# ---- group: SMALL NODE / SMALL NODES
sphere_6 = Sphere(Base=[point_4, point], Radius=Slider(6, range=0..10))
scale_nu_8 = ScaleNU(Geometry=sphere_6, Plane=PlaneXY(0, 0, 0), ScaleX=1, ScaleY=1, ScaleZ=Slider(0.45, range=0..1))  # -> Geometry, Transform

# ---- group: SMALL NODE
unit_z_17 = UnitZ(Factor=Slider(2.5, range=0..10))

# ---- group: SMALL NODE / SMALL NODES (continued)
move_16 = Move(Geometry=scale_nu_8.Geometry, Motion=unit_z_17)  # -> Geometry, Transform

# ---- group: MEDOUM NODE / BOTTOM MAGNET
cylinder_12 = Cylinder(Base=[point_2, point_3], Radius=Slider(1.5, range=0..10), Length=Slider(1.6, range=0..10))
unit_z_18 = UnitZ(Factor=Slider(-0.45, range=-2.222..10))

# ----
cap_holes_9 = CapHoles(Brep=cylinder_12)

# ---- group: MEDOUM NODE / BOTTOM MAGNET (continued)
move_17 = Move(Geometry=cap_holes_9, Motion=unit_z_18)  # -> Geometry, Transform

# ----
cap_holes_10 = CapHoles(Brep=move_17.Geometry)

# ---- group: MEDOUM NODE
solid_difference_9 = SolidDifference(BrepsA=move_11.Geometry, BrepsB=move_13.Geometry)
solid_difference_10 = SolidDifference(BrepsA=solid_difference_9, BrepsB=move_17.Geometry)

# ---- group: LARGE NOD / BOTTOM MAGNET
cylinder_13 = Cylinder(Base=[point_5, point_6], Radius=Slider(1.5, range=0..10), Length=Slider(2.2, range=0..10))
unit_z_19 = UnitZ(Factor=Slider(-1.1, range=-2.222..10))

# ----
cap_holes_11 = CapHoles(Brep=cylinder_13)

# ---- group: LARGE NOD / BOTTOM MAGNET (continued)
move_18 = Move(Geometry=cap_holes_11, Motion=unit_z_19)  # -> Geometry, Transform

# ----
cap_holes_12 = CapHoles(Brep=move_18.Geometry)

# ---- group: LARGE NOD
solid_difference_11 = SolidDifference(BrepsA=move_10.Geometry, BrepsB=move_14.Geometry)
solid_difference_12 = SolidDifference(BrepsA=solid_difference_11, BrepsB=move_18.Geometry)

# ---- group: SMALL NODE / BOTTOM MAGNET
cylinder_14 = Cylinder(Base=[point_4, point], Radius=Slider(1.5, range=0..10), Length=Slider(1.5, range=0..10))
unit_z_20 = UnitZ(Factor=Slider(-0.5, range=-2.222..10))

# ----
cap_holes_13 = CapHoles(Brep=cylinder_14)

# ---- group: SMALL NODE / BOTTOM MAGNET (continued)
move_19 = Move(Geometry=cap_holes_13, Motion=unit_z_20)  # -> Geometry, Transform

# ----
cap_holes_14 = CapHoles(Brep=move_19.Geometry)

# ---- group: SMALL NODE (continued)
solid_difference_13 = SolidDifference(BrepsA=move_16.Geometry, BrepsB=move_15.Geometry)
solid_difference_14 = SolidDifference(BrepsA=solid_difference_13, BrepsB=move_19.Geometry)

# ---- group: NODES - XY PLANE
brep_2 = Brep(brep)
solid_difference_15 = SolidDifference(BrepsA=solid_difference_14, BrepsB=brep_2)
solid_difference_16 = SolidDifference(BrepsA=solid_difference_10, BrepsB=brep_2)
solid_difference_17 = SolidDifference(BrepsA=solid_difference_12, BrepsB=brep_2)

# ---- group: BAKE
panel = Panel("BAKE ")
group = Group(Objects=[solid_difference_15, solid_difference_16, solid_difference_17, solid_difference_8])

# ==== cluster Cluster
relay = ClusterInput()
curve = ClusterInput()
construct_domain = ConstructDomain(DomainStart=Slider(1, range=0..1), DomainEnd=Slider(100, range=0..100))
construct_domain_2 = ConstructDomain(DomainStart=Slider(0, range=0..100), DomainEnd=Slider(1, range=0..1))
curve_middle = CurveMiddle(Curve=curve)
number = ClusterInput()
seed = ClusterInput()
geometry = ClusterInput()
random = Random(Range=construct_domain, Number=relay, Seed=2)
random_2 = Random(Range=construct_domain_2, Number=number, Seed=seed)
scale = Scale(Geometry=geometry, Center=curve_middle, Factor=Slider(0.04, range=0..1))  # -> Geometry, Transform
populate_geometry = PopulateGeometry(Geometry=flatten(scale.Geometry), Count=random_2, Seed=random)
population = ClusterOutput(populate_geometry)
curve_2 = ClusterInput()
curve_3 = ClusterInput()
horizontal_frame = HorizontalFrame(Curve=curve_2, Parameter=populate_geometry)
length = Length(Curve=curve_3)
multiplication = Multiplication(A=length, B=Slider(0.59, range=0..1))
deconstruct_plane = DeconstructPlane(Plane=horizontal_frame)  # -> Origin, XAxis, YAxis, ZAxis
result = ClusterOutput(multiplication)
y_axis = ClusterOutput(deconstruct_plane.YAxis)
